# Grasshopper definition sustainflatable design tool.gh (Grasshopper 1.0.7)
# plug-ins: Mesh Pipe, Human UI, Human

swatch = ColourSwatch(SwatchColor=RGB(173, 173, 173))
swatch_2 = ColourSwatch(SwatchColor=RGB(230, 230, 230))
panel = Panel("""Select..
Novec7000
Acetaldehyde
Butadiene""")
panel_2 = Panel("""Select..
Thermal
Moisture
Kinetic""")
panel_3 = Panel("""Select..
Low Elastic
Rigid
High Elastic""")
label = CreateLabel(LabelText="1. Design", LabelSize=24, Justification=0)
label_2 = CreateLabel(LabelText="Pump", LabelSize=18, Justification=0)
label_3 = CreateLabel(LabelText=" ", LabelSize=12, Justification=0)
panel_4 = Panel("""Not used
Bridged
Isolated""")
panel_5 = Panel("""Open
Closed""")
panel_6 = Panel("""Select..
Thermal
Moisture
Bursting""")
pulldown = CreatePulldownMenu(Label="Low boiling-point Liquid: ", ListItems=panel, showLabel=True)
panel_7 = Panel("""Storage
Pump""")
pulldown_2 = CreatePulldownMenu(Label="Type", ListItems=panel_2, showLabel=True)
pulldown_3 = CreatePulldownMenu(Label="Type", ListItems=panel_3, showLabel=True)
textbox = CreateTextBox(Label="Max volume (mL)", DefaultText="50", UpdateButton=False, showLabel=True)
textbox_2 = CreateTextBox(Label="Stable pressure (kPa)", DefaultText="10", UpdateButton=False, showLabel=True)
textbox_3 = CreateTextBox(Label="Correction factor", DefaultText="1", UpdateButton=False, showLabel=True)
label_4 = CreateLabel(LabelText="Storage", LabelSize=18, Justification=0)
panel_8 = Panel("""Not used
Bridged
Isolated""")
panel_9 = Panel("""Open
Closed""")
panel_10 = Panel("""Select..
Thermal
Moisture
Bursting""")
panel_11 = Panel("""Storage
Pump""")
separator = CreateSeparator(Thickness=0.5, Horizontal=True, Color=swatch)
values = ValueListener(Elements=pulldown_2, SomeProperty=True)  # -> Values, Indices
values_2 = ValueListener(Elements=pulldown_3, SomeProperty=True)  # -> Values, Indices
values_3 = ValueListener(Elements=textbox, SomeProperty=True)  # -> Values, Indices
values_4 = ValueListener(Elements=textbox_2, SomeProperty=True)  # -> Values, Indices
values_5 = ValueListener(Elements=textbox_3, SomeProperty=True)  # -> Values, Indices
values_6 = ValueListener(Elements=pulldown, SomeProperty=True)  # -> Values, Indices
label_5 = CreateLabel(LabelText="Triggered state: ", LabelSize=12, Justification=0)
or = GateOr(A=Button(), B=False)
label_6 = CreateLabel(LabelText="Wet state: Closed", LabelSize=12, Justification=0)
pulldown_4 = CreatePulldownMenu(Label="Normal state", ListItems=panel_5, showLabel=True)
textbox_4 = CreateTextBox(Label="Open pressure (kPa)", DefaultText="0", UpdateButton=False, showLabel=True)
textbox_5 = CreateTextBox(Label="Close pressure (kPa)", DefaultText="0", UpdateButton=False, showLabel=True)
pulldown_5 = CreatePulldownMenu(Label="Trigger", ListItems=panel_7, showLabel=True)
label_7 = CreateLabel(LabelText="Dry state: Open", LabelSize=12, Justification=0)
label_8 = CreateLabel(LabelText="Triggered state: Open", LabelSize=12, Justification=0)
textbox_6 = CreateTextBox(Label="Trigger temperature (℃)", DefaultText="0", UpdateButton=False, showLabel=True)
label_9 = CreateLabel(LabelText="Normal state: Closed", LabelSize=12, Justification=0)
separator_2 = CreateSeparator(Thickness=0.5, Horizontal=True, Color=swatch)
python = GhPythonScript(x=values_2.Values, y=panel_3)  # -> bools, index; inputs y: list
# ---------- python: Python ----------
__author__ = "busin"
__version__ = "2023.03.29"

import rhinoscriptsyntax as rs
r = []
ri = 0
for i in range(len(y)):
    if x == y[i]:
        r.append(True)
        ri = i
    else:
        r.append(False)
bools = r
index = ri
# ---------- end python ----------
pulldown_6 = CreatePulldownMenu(Label="Type", ListItems=panel_6, showLabel=True)
label_10 = CreateLabel(LabelText="Triggered state: ", LabelSize=12, Justification=0)
label_11 = CreateLabel(LabelText="Wet state: Closed", LabelSize=12, Justification=0)
pulldown_7 = CreatePulldownMenu(Label="Orientation", ListItems=panel_4, showLabel=True)
pulldown_8 = CreatePulldownMenu(Label="Normal state", ListItems=panel_9, showLabel=True)
label_12 = CreateLabel(LabelText="Valve 1", LabelSize=18, Justification=0)
textbox_7 = CreateTextBox(Label="Open pressure (kPa)", DefaultText="0", UpdateButton=False, showLabel=True)
textbox_8 = CreateTextBox(Label="Close pressure (kPa)", DefaultText="0", UpdateButton=False, showLabel=True)
pulldown_9 = CreatePulldownMenu(Label="Trigger", ListItems=panel_11, showLabel=True)
label_13 = CreateLabel(LabelText="Dry state: Open", LabelSize=12, Justification=0)
label_14 = CreateLabel(LabelText="Triggered state: Open", LabelSize=12, Justification=0)
textbox_9 = CreateTextBox(Label="Trigger temperature (℃)", DefaultText="0", UpdateButton=False, showLabel=True)
python_2 = GhPythonScript(x=values.Values, y=panel_2)  # -> bools, index; inputs y: list; same code as python
label_15 = CreateLabel(LabelText="Normal state: Closed", LabelSize=12, Justification=0)
python_3 = GhPythonScript(x=values_6.Values, y=panel)  # -> bools, index; inputs y: list; same code as python
panel_12 = Panel("""1*
0*
1*""")
panel_13 = Panel("""1*
1*
0*""")
not = GateNot(A=or)
values_7 = ValueListener(Elements=textbox_5, SomeProperty=True)  # -> Values, Indices
python_4 = GhPythonScript(x=python.index, y=values_5.Values, z=values_4.Values)  # -> out, a, b
# ---------- python_4: Python ----------
__author__ = "busin"
__version__ = "2023.04.01"

import rhinoscriptsyntax as rs
if x == 3:
    a = z
    b = False
else:
    a = y
    b = True
# ---------- end python_4 ----------
values_8 = ValueListener(Elements=pulldown_4, SomeProperty=True)  # -> Values, Indices
pulldown_10 = CreatePulldownMenu(Label="Type", ListItems=panel_10, showLabel=True)
values_9 = ValueListener(Elements=textbox_4, SomeProperty=True)  # -> Values, Indices
values_10 = ValueListener(Elements=pulldown_5, SomeProperty=True)  # -> Values, Indices
pulldown_11 = CreatePulldownMenu(Label="Orientation", ListItems=panel_8, showLabel=True)
label_16 = CreateLabel(LabelText="Valve 2", LabelSize=18, Justification=0)
entwine = Entwine(Branch00=textbox, Branch01=textbox_2, Branch02=textbox_3, FlattenInputs=True)
values_11 = ValueListener(Elements=textbox_6, SomeProperty=True)  # -> Values, Indices
simplegrid = CreateSimpleGrid(UIElements=graft([label_7, label_6]), RowDefinitions="Auto", ColumnDefinitions="1*")  # -> flatten(SimpleGrid)
values_12 = ValueListener(Elements=textbox_8, SomeProperty=True)  # -> Values, Indices
values_13 = ValueListener(Elements=pulldown_8, SomeProperty=True)  # -> Values, Indices
values_14 = ValueListener(Elements=pulldown_6, SomeProperty=True)  # -> Values, Indices
merge = Merge(Data1=label_2, Data2=pulldown_2, Data3=pulldown, Data4=label_3, Data5=separator_2)
values_15 = ValueListener(Elements=textbox_7, SomeProperty=True)  # -> Values, Indices
values_16 = ValueListener(Elements=pulldown_9, SomeProperty=True)  # -> Values, Indices
separator_3 = CreateSeparator(Thickness=0.5, Horizontal=True, Color=swatch_2)
values_17 = ValueListener(Elements=pulldown_7, SomeProperty=True)  # -> Values, Indices
accent_colors = ValueList({"Amber", "Blue", "Brown", "Cobalt", "Crimson", "Cyan", "Emerald", "Green", "Indigo", "Lime", "Magenta", "Mauve", "Olive", "Orange", "Pink", "Purple", "Red", "Sienna", "Steel", "Taupe", "Teal", "Violet", "Yellow"}, selected="Steel")
filter = StreamFilter(Gate=python_4.b, Stream0=panel_13, Stream1=panel_12)
python_5 = GhPythonScript(x=values_8.Values)  # -> a
# ---------- python_5: Python ----------
__author__ = "busin"
__version__ = "2023.03.29"

import rhinoscriptsyntax as rs
if x == 'Open':
    a = True
elif x == 'Closed':
    a = False
# ---------- end python_5 ----------
simplegrid_2 = CreateSimpleGrid(UIElements=graft([label_9, label_8]), RowDefinitions="Auto", ColumnDefinitions="1*")  # -> flatten(SimpleGrid)
values_18 = ValueListener(Elements=textbox_9, SomeProperty=True)  # -> Values, Indices
python_6 = GhPythonScript(x=values_10.Values, y=panel_7)  # -> bools, index; inputs y: list; same code as python
simplegrid_3 = CreateSimpleGrid(UIElements=graft([textbox_4, textbox_5]), RowDefinitions="Auto", ColumnDefinitions="1*")  # -> flatten(SimpleGrid)
simplegrid_4 = CreateSimpleGrid(UIElements=graft([label_13, label_11]), RowDefinitions="Auto", ColumnDefinitions="1*")  # -> flatten(SimpleGrid)
python_7 = GhPythonScript(x=python_5, y="Triggered state: ")  # -> out, a; inputs x: Boolean
# ---------- python_7: Python ----------
__author__ = "busin"
__version__ = "2023.03.29"

import rhinoscriptsyntax as rs
if x:
    a = y + "Closed"
else:
    a = y + "Open"
# ---------- end python_7 ----------
launchwin = LaunchWindow(
    Show=not,
    Name="Sustainflatable Design Tool",
    Width=Slider(685, range=0..1000),
    Height=Slider(620, range=0..1000),
    ChildStatus=2,
    EnableHorizScroll=False)
values_19 = ValueListener(Elements=pulldown_10, SomeProperty=True)  # -> Values, Indices
separator_4 = CreateSeparator(Thickness=0.5, Horizontal=True, Color=swatch)
values_20 = ValueListener(Elements=pulldown_11, SomeProperty=True)  # -> Values, Indices
python_8 = GhPythonScript(x=values_13.Values)  # -> a; same code as python_5
simplegrid_5 = CreateSimpleGrid(UIElements=graft([label_15, label_14]), RowDefinitions="Auto", ColumnDefinitions="1*")  # -> flatten(SimpleGrid)
python_9 = GhPythonScript(x=values_16.Values, y=panel_11)  # -> bools, index; inputs y: list; same code as python
simplegrid_6 = CreateSimpleGrid(UIElements=graft([textbox_7, textbox_8]), RowDefinitions="Auto", ColumnDefinitions="1*")  # -> flatten(SimpleGrid)
python_10 = GhPythonScript(x=python_8, y="Triggered state: ")  # -> out, a; inputs x: Boolean; same code as python_7
python_11 = GhPythonScript(x=values_17.Values, y=panel_4)  # -> bools, index; inputs y: list; same code as python
python_12 = GhPythonScript(x=values_14.Values, y=panel_6)  # -> bools, index; inputs y: list; same code as python
equals = Equality(FirstNumber=python_2.index, SecondNumber=Slider(1, range=0..1))  # -> Equality, Inequality
setlabel = SetLabelContents(LabelToModify=label_5, NewLabelContents=python_7.a)
merge_2 = Merge(Data1=simplegrid)
python_13 = GhPythonScript(x=values_19.Values, y=panel_10)  # -> bools, index; inputs y: list; same code as python
python_14 = GhPythonScript(x=values_20.Values, y=panel_8)  # -> bools, index; inputs y: list; same code as python
simplegrid_7 = CreateSimpleGrid(UIElements=entwine, RowDefinitions="Auto", ColumnDefinitions=filter)  # -> flatten(SimpleGrid)
simplegrid_8 = CreateSimpleGrid(UIElements=graft([pulldown_4, label_5]), RowDefinitions="Auto", ColumnDefinitions="1*")  # -> flatten(SimpleGrid)
setlabel_2 = SetLabelContents(LabelToModify=label_10, NewLabelContents=python_10.a)
merge_3 = Merge(Data1=simplegrid_4)
python_15 = GhPythonScript(x=python_2.index, y=python_3.index)  # -> out, a
# ---------- python_15: Python ----------
__author__ = "busin"
__version__ = "2023.04.07"

import rhinoscriptsyntax as rs
if x == 1:
    if y == 1:
        a = 'Novec7000, boiling point at 1atm: 34℃'
    elif y == 2:
        a = 'Acetaldehyde, boiling point at 1atm: 20.8℃'
    elif y == 3:
        a = '1,2-Butadiene, boiling point at 1atm: 10.9℃'
    else:
        a = ''
elif x == 2:
    a = 'Default: Max pressure of 28kPa in this pump'
elif x == 3:
    a = 'Default: Wind pump'
# ---------- end python_15 ----------
simplegrid_9 = CreateSimpleGrid(UIElements=graft([pulldown_8, label_10]), RowDefinitions="Auto", ColumnDefinitions="1*")  # -> flatten(SimpleGrid)
item = ListItem(List=python_11.bools, Index=0, Wrap=True)
hideshow = HideShowElement(ElementToHideShow=pulldown, Show=equals.Equality, Collapse=True, Disable=False)
winprops = SetWindowProperties(Window=launchwin, AccentColor=accent_colors, ShowTitleBar=True, ScaleFactor=1)
merge_4 = Merge(Data1=simplegrid_2, Data2=simplegrid_3, Data3=pulldown_5)
item_2 = ListItem(List=python_14.bools, Index=0, Wrap=True)
merge_5 = Merge(Data1=label_4, Data2=pulldown_3, Data3=simplegrid_7, Data4=separator)
not_2 = GateNot(A=item)
and = GateAnd(A=not_2, B=python_12.bools)
merge_6 = Merge(Data1=simplegrid_8, Data2=textbox_6)
merge_7 = Merge(Data1=simplegrid_5, Data2=simplegrid_6, Data3=pulldown_9)
setlabel_3 = SetLabelContents(LabelToModify=label_3, NewLabelContents=python_15.a)
not_3 = GateNot(A=item_2)
and_2 = GateAnd(A=not_3, B=python_13.bools)
merge_8 = Merge(Data1=simplegrid_9, Data2=textbox_9)
merge_9 = Merge(Data1=merge_6, Data2=merge_2, Data3=merge_4)
item_3 = ListItem(List=and, Index=0, Wrap=True)  # -> Item, Item1, Item2, Item3
merge_10 = Merge(Data1=merge_8, Data2=merge_3, Data3=merge_7)
item_4 = ListItem(List=and_2, Index=0, Wrap=True)  # -> Item, Item1, Item2, Item3
hideshow_2 = HideShowElement(ElementToHideShow=merge_2, Show=item_3.Item2, Collapse=True, Disable=False)
hideshow_3 = HideShowElement(ElementToHideShow=merge_6, Show=item_3.Item1, Collapse=True, Disable=False)
hideshow_4 = HideShowElement(ElementToHideShow=merge_4, Show=item_3.Item3, Collapse=True, Disable=False)
hideshow_5 = HideShowElement(ElementToHideShow=merge_3, Show=item_4.Item2, Collapse=True, Disable=False)
hideshow_6 = HideShowElement(ElementToHideShow=merge_8, Show=item_4.Item1, Collapse=True, Disable=False)
hideshow_7 = HideShowElement(ElementToHideShow=pulldown_6, Show=not_2, Collapse=True, Disable=False)
hideshow_8 = HideShowElement(ElementToHideShow=merge_7, Show=item_4.Item3, Collapse=True, Disable=False)
hideshow_9 = HideShowElement(ElementToHideShow=pulldown_10, Show=not_3, Collapse=True, Disable=False)
python_16 = GhPythonScript(type=python.index, volume=values_3.Values, corr_factor=python_4.a)  # -> out, storage; inputs type: Int32
# ---------- python_16: Python ----------
__author__ = "busin"
__version__ = "2023.03.29"

import rhinoscriptsyntax as rs
storage = [type, volume, corr_factor]
# ---------- end python_16 ----------
merge_11 = Merge(Data1=label_12, Data2=pulldown_7, Data3=pulldown_6, Data4=merge_9, Data5=separator_3)  # -> flatten(Result)
python_17 = GhPythonScript(
    type=python_12.index,
    normal_state=python_5,
    orientation=python_11.index,
    trigger_temp=values_11.Values,
    trigger_p1=values_9.Values,
    trigger_p2=values_7.Values,
    trigger=python_6.index)  # -> out, valve, valve_display; inputs type: Int32, normal_state: Boolean, orientation: Int32, trigger: Int32
# ---------- python_17: Python ----------
__author__ = "busin"
__version__ = "2023.03.29"

import rhinoscriptsyntax as rs
r = []

# type
r.append(int(type))

# normal_state
ns = 1
if type == 1:
    ns = int(normal_state)
elif type == 2:
    ns = 1
elif type == 3:
    ns = 0
else:
    ns = 0
r.append(ns)
    
# orientation
o = 0
if orientation == 0:
    o = 0
elif orientation == 1:
    o = 1
elif orientation == 2:
    o = 0
if type == 0:
    o = 0
r.append(o)

# trigger v1 v2
if type == 1:
    r.append(trigger_temp)
    r.append(trigger_temp)
elif type == 2:
    r.append(0.5)
    r.append(0.5)
elif type == 3:
    r.append(trigger_p1+101.3)
    r.append(trigger_p2+101.3)
else:
    r.append(0)
    r.append(0)
    
# trigger
if type == 3:
    if trigger == 1:
        r.append('pump')
    elif trigger == 0:
        r.append('storage')
else:
    r.append('env')
    
valve = r

valve_display = [int(type), int(orientation)]
# ---------- end python_17 ----------
merge_12 = Merge(Data1=label_16, Data2=pulldown_11, Data3=pulldown_10, Data4=merge_10, Data5=separator_4)  # -> flatten(Result)
python_18 = GhPythonScript(
    type=python_13.index,
    normal_state=python_8,
    orientation=python_14.index,
    trigger_temp=values_18.Values,
    trigger_p1=values_15.Values,
    trigger_p2=values_12.Values,
    trigger=python_9.index)  # -> out, valve, valve_display; inputs type: Int32, normal_state: Boolean, orientation: Int32, trigger: Int32; same code as python_17
panel_14 = Panel(python_17.valve)
panel_15 = Panel(python_18.valve)
merge_13 = Merge(Data1=label, Data2=merge, Data3=merge_5, Data4=merge_11, Data5=merge_12)
panel_16 = Panel("""0
0
0
0
0
env""")
# type: 1-thermal, 2-wet, 3-mechanical
# normal_state
# orientation: 0-isolated, 1-bridges
# trigger1
# trigger2
# triger
python_19 = GhPythonScript(v1=panel_16, v2=panel_14, v3=panel_15)  # -> out, valves; inputs v1: list, v2: list, v3: list
# ---------- python_19: Python ----------
__author__ = "busin"
__version__ = "2023.03.29"

import rhinoscriptsyntax as rs
#type = []
#state_normal = []
#orientation = []
#threshold_to_on = []
#threshold_to_off = []
#for i in range(3):
#    type = 

valves = [v1, v2, v3]
# ---------- end python_19 ----------
textbox_10 = CreateTextBox(Label="Cycle count", DefaultText="1", UpdateButton=False, showLabel=True)
values_21 = ValueListener(Elements=textbox_10, SomeProperty=True)  # -> Values, Indices
python_20 = GhPythonScript(x=values_21.Values)  # -> a; inputs x: Int32
# ---------- python_20: Python ----------
__author__ = "busin"
__version__ = "2023.03.30"

import rhinoscriptsyntax as rs
a=[]
for i in range(x):
    a.append(False)
for i in range(10-x):
    a.append(True)
# ---------- end python_20 ----------
item_5 = ListItem(List=python_20, Index=0, Wrap=True)  # -> Item, Item1, Item2, Item3, Item4, Item5, Item6, Item7, Item8, Item9
label_17 = CreateLabel(LabelText="2. Environmental Cycles", LabelSize=24, Justification=0)
cluster = Cluster(H="Cycle 10", D=item_5.Item9)  # -> E, panel, L, R
cluster_2 = Cluster(H="Cycle 9", D=item_5.Item8)  # -> E, panel, L, R
cluster_3 = Cluster(H="Cycle 2", D=item_5.Item1)  # -> E, panel, L, R
cluster_4 = Cluster(H="Cycle 4", D=item_5.Item3)  # -> E, panel, L, R
cluster_5 = Cluster(H="Cycle 1", D=item_5.Item)  # -> E, panel, L, R
cluster_6 = Cluster(H="Cycle 6", D=item_5.Item5)  # -> E, panel, L, R
cluster_7 = Cluster(H="Cycle 3", D=item_5.Item2)  # -> E, panel, L, R
cluster_8 = Cluster(H="Cycle 8", D=item_5.Item7)  # -> E, panel, L, R
cluster_9 = Cluster(H="Cycle 5", D=item_5.Item4)  # -> E, panel, L, R
cluster_10 = Cluster(H="Cycle 7", D=item_5.Item6)  # -> E, panel, L, R
values_22 = ValueListener(Elements=cluster.R, SomeProperty=True)  # -> Values, Indices
values_23 = ValueListener(Elements=cluster_2.R, SomeProperty=True)  # -> Values, Indices
values_24 = ValueListener(Elements=cluster_3.R, SomeProperty=True)  # -> Values, Indices
values_25 = ValueListener(Elements=cluster_5.R, SomeProperty=True)  # -> Values, Indices
values_26 = ValueListener(Elements=cluster_4.R, SomeProperty=True)  # -> Values, Indices
values_27 = ValueListener(Elements=cluster_6.R, SomeProperty=True)  # -> Values, Indices
values_28 = ValueListener(Elements=cluster_7.R, SomeProperty=True)  # -> Values, Indices
values_29 = ValueListener(Elements=cluster_8.R, SomeProperty=True)  # -> Values, Indices
values_30 = ValueListener(Elements=cluster_9.R, SomeProperty=True)  # -> Values, Indices
values_31 = ValueListener(Elements=cluster_10.R, SomeProperty=True)  # -> Values, Indices
bang = ExplodeTree(Data=values_22.Values)  # -> Branch0, Branch1, Branch2, Branch3
bang_2 = ExplodeTree(Data=values_23.Values)  # -> Branch0, Branch1, Branch2, Branch3
bang_3 = ExplodeTree(Data=values_24.Values)  # -> Branch0, Branch1, Branch2, Branch3
bang_4 = ExplodeTree(Data=values_26.Values)  # -> Branch0, Branch1, Branch2, Branch3
bang_5 = ExplodeTree(Data=values_25.Values)  # -> Branch0, Branch1, Branch2, Branch3
bang_6 = ExplodeTree(Data=values_27.Values)  # -> Branch0, Branch1, Branch2, Branch3
bang_7 = ExplodeTree(Data=values_28.Values)  # -> Branch0, Branch1, Branch2, Branch3
bang_8 = ExplodeTree(Data=values_29.Values)  # -> Branch0, Branch1, Branch2, Branch3
bang_9 = ExplodeTree(Data=values_30.Values)  # -> Branch0, Branch1, Branch2, Branch3
bang_10 = ExplodeTree(Data=values_31.Values)  # -> Branch0, Branch1, Branch2, Branch3
python_21 = GhPythonScript(x=bang.Branch0, y=cluster.panel)  # -> a
# ---------- python_21: Python ----------
__author__ = "busin"
__version__ = "2023.03.30"

import rhinoscriptsyntax as rs
a = y + str(x)
# ---------- end python_21 ----------
python_22 = GhPythonScript(x=bang_2.Branch0, y=cluster_2.panel)  # -> a; same code as python_21
python_23 = GhPythonScript(x=bang_3.Branch0, y=cluster_3.panel)  # -> a; same code as python_21
python_24 = GhPythonScript(temp_low=bang.Branch0, temp_high=bang.Branch1, wet=bang.Branch2, windspeed=bang.Branch3)  # -> out, a; inputs wet: Int32
# ---------- python_24: Python ----------
__author__ = "busin"
__version__ = "2023.03.30"

import rhinoscriptsyntax as rs
a = [temp_low, temp_high, temp_low, wet, windspeed]
# ---------- end python_24 ----------
python_25 = GhPythonScript(x=bang_4.Branch0, y=cluster_4.panel)  # -> a; same code as python_21
python_26 = GhPythonScript(x=bang_5.Branch0, y=cluster_5.panel)  # -> a; same code as python_21
python_27 = GhPythonScript(x=bang_6.Branch0, y=cluster_6.panel)  # -> a; same code as python_21
python_28 = GhPythonScript(temp_low=bang_2.Branch0, temp_high=bang_2.Branch1, wet=bang_2.Branch2, windspeed=bang_2.Branch3)  # -> out, a; inputs wet: Int32; same code as python_24
python_29 = GhPythonScript(x=bang_7.Branch0, y=cluster_7.panel)  # -> a; same code as python_21
python_30 = GhPythonScript(x=bang_8.Branch0, y=cluster_8.panel)  # -> a; same code as python_21
python_31 = GhPythonScript(temp_low=bang_3.Branch0, temp_high=bang_3.Branch1, wet=bang_3.Branch2, windspeed=bang_3.Branch3)  # -> out, a; inputs wet: Int32; same code as python_24
python_32 = GhPythonScript(x=bang_9.Branch0, y=cluster_9.panel)  # -> a; same code as python_21
python_33 = GhPythonScript(temp_low=bang_4.Branch0, temp_high=bang_4.Branch1, wet=bang_4.Branch2, windspeed=bang_4.Branch3)  # -> out, a; inputs wet: Int32; same code as python_24
python_34 = GhPythonScript(x=bang_10.Branch0, y=cluster_10.panel)  # -> a; same code as python_21
python_35 = GhPythonScript(temp_low=bang_5.Branch0, temp_high=bang_5.Branch1, wet=bang_5.Branch2, windspeed=bang_5.Branch3)  # -> out, a; inputs wet: Int32; same code as python_24
python_36 = GhPythonScript(temp_low=bang_6.Branch0, temp_high=bang_6.Branch1, wet=bang_6.Branch2, windspeed=bang_6.Branch3)  # -> out, a; inputs wet: Int32; same code as python_24
python_37 = GhPythonScript(temp_low=bang_7.Branch0, temp_high=bang_7.Branch1, wet=bang_7.Branch2, windspeed=bang_7.Branch3)  # -> out, a; inputs wet: Int32; same code as python_24
python_38 = GhPythonScript(temp_low=bang_8.Branch0, temp_high=bang_8.Branch1, wet=bang_8.Branch2, windspeed=bang_8.Branch3)  # -> out, a; inputs wet: Int32; same code as python_24
python_39 = GhPythonScript(temp_low=bang_9.Branch0, temp_high=bang_9.Branch1, wet=bang_9.Branch2, windspeed=bang_9.Branch3)  # -> out, a; inputs wet: Int32; same code as python_24
python_40 = GhPythonScript(temp_low=bang_10.Branch0, temp_high=bang_10.Branch1, wet=bang_10.Branch2, windspeed=bang_10.Branch3)  # -> out, a; inputs wet: Int32; same code as python_24
setlabel_4 = SetLabelContents(LabelToModify=cluster.L, NewLabelContents=python_21)
setlabel_5 = SetLabelContents(LabelToModify=cluster_2.L, NewLabelContents=python_22)
setlabel_6 = SetLabelContents(LabelToModify=cluster_3.L, NewLabelContents=python_23)
setlabel_7 = SetLabelContents(LabelToModify=cluster_4.L, NewLabelContents=python_25)
setlabel_8 = SetLabelContents(LabelToModify=cluster_5.L, NewLabelContents=python_26)
setlabel_9 = SetLabelContents(LabelToModify=cluster_6.L, NewLabelContents=python_27)
setlabel_10 = SetLabelContents(LabelToModify=cluster_7.L, NewLabelContents=python_29)
setlabel_11 = SetLabelContents(LabelToModify=cluster_8.L, NewLabelContents=python_30)
setlabel_12 = SetLabelContents(LabelToModify=cluster_9.L, NewLabelContents=python_32)
panel_17 = Panel(python_24.a)
setlabel_13 = SetLabelContents(LabelToModify=cluster_10.L, NewLabelContents=python_34)
panel_18 = Panel(python_28.a)
panel_19 = Panel(python_31.a)
panel_20 = Panel(python_33.a)
panel_21 = Panel(python_35.a)
panel_22 = Panel(python_36.a)
panel_23 = Panel(python_37.a)
panel_24 = Panel(python_38.a)
panel_25 = Panel(python_39.a)
panel_26 = Panel(python_40.a)
data = Data(panel_17)
data_2 = Data(panel_18)
data_3 = Data(panel_19)
data_4 = Data(panel_20)
data_5 = Data(panel_21)
data_6 = Data(panel_22)
data_7 = Data(panel_23)
data_8 = Data(panel_24)
data_9 = Data(panel_25)
data_10 = Data(panel_26)
panel_27 = Panel("""Design
Simulation""")
merge_14 = Merge(
    Data1=cluster_5.E,
    Data2=cluster_3.E,
    Data3=cluster_7.E,
    Data4=cluster_4.E,
    Data5=cluster_9.E,
    Data6=cluster_6.E,
    Data7=cluster_10.E,
    Data8=cluster_8.E,
    Data9=cluster_2.E,
    Data10=cluster.E)
python_41 = GhPythonScript(
    count=values_21.Values,
    c1=data_5,
    c2=data_3,
    c3=data_7,
    c4=data_4,
    c5=data_9,
    c6=data_6,
    c7=data_10,
    c8=data_8,
    c9=data_2,
    c10=data)  # -> out, a; inputs count: Int32, c1: list, c2: list, c3: list, c4: list, c5: list, c6: list, c7: list, c8: list, c9: list, c10: list
# ---------- python_41: Python ----------
__author__ = "busin"
__version__ = "2023.03.30"

import rhinoscriptsyntax as rs
a = [count, c1, c2, c3, c4, c5, c6, c7, c8, c8, c10]
print(a)
# ---------- end python_41 ----------
scrollviewer = CreateScrollViewer(UIElements=merge_14, HorizontalScrollBarVisibility=1, VerticalScrollBarVisibility=0, Height=Slider(300, range=0..1000))
stack = CreateStack(UIElements=merge_13, Horizontal=False)
panel_28 = Panel("""330
10
310""")
trigger = Trigger(Interval=500, TimerInterval=500, Target=c_script)
c_script = CSharpScript()  # -> out, A
# ---------- c_script: C# ----------
    A = i;
    if (i == false){
      i = true;
    }
# ---------- c_script: C# additional code ----------
  bool i = false;
# ---------- end c_script ----------
not_4 = GateNot(A=c_script.A)
trigger_2 = Trigger(Interval=100, TimerInterval=100, Target=python_45)
not_5 = GateNot(A=c_script.A)
toggle = BooleanToggle(True)
or_2 = GateOr(A=not_5, B=Button())
bool = Boolean(or_2)
number_slider = Slider(30, range=-0.2..30)
number_slider_2 = Slider(-0.2, range=-0.2..30)
label_18 = CreateLabel(LabelText="4. Export", LabelSize=24, Justification=0)
# type: 1-thermal, 2-wet, 3-mechanical
# orientation: 0-not used, 1-bridges, 2-isolated
number_slider_3 = Slider(20, range=0..100)
cycle = Slider(1, range=0..10)
number_slider_4 = Slider(2, range=0..10)
number_slider_5 = Slider(32, range=0..100)
number_slider_6 = Slider(30, range=0..100)
label_19 = CreateLabel(LabelText="Windspeed (m/s): ", LabelSize=12, Justification=0)
label_20 = CreateLabel(LabelText="Temperature (℃): ", LabelSize=12, Justification=0)
label_21 = CreateLabel(LabelText="Moisture/water bath: ", LabelSize=12, Justification=0)
button = CreateButton(ButtonName="Export model and material list", ButtonStyle=0)
number_slider_7 = Slider(47, range=0..100)
slider = CreateSlider(Slider=cycle, ShowBounds=False, ShowTicks=False, ShowTooltip=False, ShowValLabel=True, showLabel=True)
button_2 = CreateButton(ButtonName="Update Preview", ButtonStyle=0)
separator_5 = CreateSeparator(Thickness=0.5, Horizontal=True, Color=swatch)
label_22 = CreateLabel(LabelText="3. Functional Preview", LabelSize=24, Justification=0)
cluster_11 = Cluster_4()  # -> M, M_2
values_32 = ValueListener(Elements=button, SomeProperty=True)  # -> Values, Indices
values_33 = ValueListener(Elements=button_2, SomeProperty=True)  # -> Values, Indices
or_3 = GateOr(A=not_4, C=values_33.Values, B=Button())
bool_2 = Boolean(or_3)
python_42 = GhPythonScript(
    pump_input=python_2.index,
    storage_input=python_16.storage,
    valve_input=python_19.valves,
    cycle_input=python_41.a,
    update=bool_2)  # -> out, results, manuals; inputs pump_input: Int32, storage_input: list, valve_input: list, cycle_input: list
# ---------- python_42: Python ----------
import rhinoscriptsyntax as rs

import math

p_atm = 1.013e2
p_check = 0 # 3.45

def linlist(a, b, step):
    r = []
    if step == 0:
        r = [a, b]
    else:
        i = a
        if a < b:
            while i <= b:
                r.append(i)
                i+=step
        elif a > b:
            while i >= b:
                r.append(i)
                i-=step
        else:
            r = [a, b]
    return r

class Environment:
    pressure = 0
    temperature = 0
    wetness = 0
    windspeed = 0
    pumping_pressure = 0
    
    def __init__(self, temperature, wetness, windspeed):
        self.pressure = p_atm
        self.wetness = wetness
        self.temperature = temperature
        self.windspeed = windspeed
        self.pumping_pressure = p_atm

def Novec_pressure(T): # celces
        p_vapor = math.exp(-3548.6/(T+273.15) + 22.978)/1000
        return p_vapor

def Wet_pressure(wet):
    if wet>0.5:
        p = 28.5 + p_atm
    else:
        p = p_atm
    return p

def Wind_pressure(speed):
    p = 0
    p = p_atm+0.077*speed*speed
    return p

class Pump:
    type = 0 # 1-thermal, 2-wet, 3-mechanical
    max_pressure = 0 #kPa
    max_pumping_volume = 0 #mL
    body_volume = 0 #mL 
    
    pumping_volume = 0
    pressure = p_atm
    
    def __init__(self, typeindex, args): # initiate
        self.type = typeindex
        if self.type == 1:
            self.body_volume = 56.54
            self.max_pumping_volume = 30
        elif self.type == 2:
            self.body_volume = 56.54
            self.max_pumping_volume = 20
        elif self.type == 3:
            self.body_volume = 56.54
            self.max_pumping_volume = 22
            
    def Update(self, pumping_volume_new, pressure_new):
        self.pumping_volume = pumping_volume_new
        self.pressure = pressure_new
            
class Storage:
    type = 0 # 1-soft, 2-rigid, 3-elastic
    max_volume = 0
    
    pressure = p_atm # current pressure
    volume_in_p0 = 0 # current volume of stored air at p0
    p_elastic = 10
    
    k = 1
    
    def __init__(self, typeindex, args, k): # initiate
        self.type = typeindex
        if self.type == 1:
            self.max_volume = args # max volume
            self.k = k
        elif self.type == 2:
            self.max_volume = args # constant volume
            self.volume_in_p0 += self.max_volume
            self.k = k
        elif self.type == 3: # constant pressure
            self.max_volume = args
            self.p_elastic = k
    
    def Evaluate_pressure(self, v_in_p0): # input new v_in, output new pressure
        p = 0
        if self.type == 1:
            if v_in_p0 < self.max_volume:
                p = p_atm
            else:
                p = p_atm / self.max_volume * ((v_in_p0 - self.max_volume)*self.k+self.max_volume)
        elif self.type == 2:
            p = p_atm / self.max_volume * ((v_in_p0 - self.max_volume)*self.k+self.max_volume)
        elif self.type == 3:
            if 0 < v_in_p0 < self.max_volume:
                p = self.p_elastic + p_atm
            elif v_in_p0 >= self.max_volume:
                p = self.p_elastic + p_atm + 100
            else:
                p = p_atm
        return p

    def Evaluate_v_in(self, p, v_in): # input new pressure and old v_in, output new v_in
        new_v_in = 0
        if self.type == 1:
            if p <= p_atm:
                if v_in > self.max_volume:
                    new_v_in = self.max_volume
                else:
                    new_v_in = v_in
            else:
                new_v_in = ((p / p_atm -1)/self.k + 1)* self.max_volume
        elif self.type == 2:
            new_v_in = ((p / p_atm -1)/self.k + 1)* self.max_volume
        elif self.type == 3:
            new_v_in = v_in
        return new_v_in
    
    def Set_air(self, v_in):
        self.volume_in_p0 = v_in
        self.pressure = self.Evaluate_pressure(v_in)
        
    def Add_air(self, v_in_new):
        self.Set_air(v_in_new + self.volume_in_p0)
        
    def Set_pressure(self, p):
        if self.type == 3:
            if p < self.p_elastic + p_atm:
                self.pressure = p_atm
                self.volume_in_p0 = 0
            else:
                self.pressure = self.p_elastic
        else:
            self.pressure = p
            self.volume_in_p0 = self.Evaluate_v_in(p, self.volume_in_p0)
        
        
class Valve:
    type = 0 # 1-thermal, 2-wet, 3-bursting
    state_normal = False # normally off
    orientation = 0 # 0-isolate, 1-bridge, 2-connect to air
    
    threshold_to_on = 0
    threshold_to_off = 0
    # threshold_triger = 0
    
    state = False # on-True, off-False
    
    buffer_list = []
    buffer_length = 5
    
    def __init__(self, typeindex, normal_state, orientation, args1, args2, arg_triger): # initiate
        self.type = typeindex
        self.state_normal = normal_state
        self.orientation = orientation
        
        self.threshold_to_on = args1
        self.threshold_to_off = args2
        self.threshold_triger = arg_triger
        
        self.buffer_list = []
        for i in range(self.buffer_length):
            self.buffer_list.append(0)
            
    def Update(self, args=-100):
        threshold = 0
        if self.state == self.state_normal:
            threshold = self.threshold_to_on
        else:
            threshold = self.threshold_to_off
        
        t = 0
        if args > -100:
            t = args
        else:
            if self.type == 3:
                t = self.threshold_triger.pressure
            elif self.type == 2:
                t = self.threshold_triger.wetness
            elif self.type == 1:
                t = self.threshold_triger.temperature
        
        self.buffer_list.append(t)
        if len(self.buffer_list) > self.buffer_length:
            self.buffer_list.pop(0)
        t_mean = 0
        for i in range(self.buffer_length):
            t_mean += self.buffer_list[i]
        t_mean = t_mean / self.buffer_length

        # if self.type == 3:
        #     print(t_mean, threshold)
        if t_mean <= threshold:
            self.state = self.state_normal
        else:
            self.state = not self.state_normal
        #print(self.buffer_list)

    def Set_state(self, state):
        self.state = state
    
    
class Circuit:
    pump = Pump(0,0)
    storage = Storage(0,0,1)
    
    valve1 = Valve(0, False, 0, 0, 0, '')
    valve2 = Valve(0, False, 0, 0, 0, '')
    valve3 = Valve(0, False, 0, 0, 0, '')
    
    env = ''
    
    def __init__(self, env):
        self.env = env
        pass
    
    def Pump_air(self): 
        # pump to storage
        new_pressure = self.env.pumping_pressure
        
        pump_to_storage = False
        compare_pressure = 0
        if self.storage.type == 3:
            compare_pressure = self.storage.p_elastic + p_atm
        else:
            compare_pressure = self.storage.pressure

        if new_pressure - compare_pressure > p_check:
            if self.valve2.orientation == 0:
                pump_to_storage = True
            elif self.valve2.orientation == 1:
                if self.valve2.state == True:
                    pump_to_storage = True
            elif self.valve2.orientation == 2:
                if self.valve2.state == False:
                    pump_to_storage = True
        if pump_to_storage:
            step = 0.05
            v_in_new = 0
            flag = True
            
            # 试探法求解当前气压下的最大进气量
            while(flag):
                v_in_new = v_in_new + step
                
                p_new = self.storage.Evaluate_pressure(self.storage.volume_in_p0 + v_in_new) + p_check
                pumping_volume_new = self.pump.body_volume - (self.pump.pressure*(self.pump.body_volume-self.pump.pumping_volume)-p_atm*v_in_new)/p_new
            
                p_flag = p_new <= new_pressure
                v_flag = pumping_volume_new <= self.pump.max_pumping_volume
            
                if p_flag and v_flag:
                    flag = True
                else:
                    flag = False
                    v_in_new = v_in_new - step
                    self.storage.Add_air(v_in_new)
                    p_new = self.storage.pressure + p_check
                    
                    if v_flag == False:
                        pumping_volume_new = self.pump.max_pumping_volume
                    else:
                        pumping_volume_new = self.pump.body_volume - (self.pump.pressure*(self.pump.body_volume-self.pump.pumping_volume)-p_atm*v_in_new)/p_new
                    self.pump.Update(pumping_volume_new, p_new)
                    #print('%.2f'%v_in_new, '%.2f'%self.storage.volume_in_p0, '%.2f'%self.storage.pressure, '%.2f'%self.pump.pumping_volume, '%.2f'%self.pump.pressure, v_flag, p_flag, sep='\t')
        # air to pump
        air_to_pump = False
        if self.valve2.orientation == 2 and self.valve2.state == True:
            air_to_pump = True
            if self.valve2.threshold_triger == self.pump:
                self.pump.Update(0, self.valve2.threshold_to_off)
            else:
                self.pump.Update(0, p_atm)
        elif new_pressure < p_atm - p_check:
            if self.valve1.orientation == 1:
                if self.valve1.state == True:
                    air_to_pump = True
            else:
                air_to_pump = True
            if air_to_pump:
                self.pump.Update(0, p_atm - p_check)
        
        # pump to pump
        pump_to_pump = False
        if pump_to_storage == False and air_to_pump == False and abs(new_pressure - self.pump.pressure) > 0.01:
            pump_to_pump = True
        if pump_to_pump:
            pumping_volume_new = self.pump.body_volume - self.pump.pressure*(self.pump.body_volume-self.pump.pumping_volume)/new_pressure
            pump_pressure_new = new_pressure
            if pumping_volume_new > self.pump.max_pumping_volume:
                pumping_volume_new = self.pump.max_pumping_volume
                pump_pressure_new = self.pump.pressure*(self.pump.body_volume-self.pump.pumping_volume)/(self.pump.body_volume-pumping_volume_new)
            elif pumping_volume_new < 0:
                pumping_volume_new = 0
                pump_pressure_new = self.pump.pressure*(self.pump.body_volume-self.pump.pumping_volume)/(self.pump.body_volume-pumping_volume_new)
            self.pump.Update(pumping_volume_new, pump_pressure_new)
            # print('%.2f'%0, '%.2f'%self.storage.volume_in_p0, '%.2f'%self.storage.pressure, '%.2f'%self.pump.pumping_volume, '%.2f'%self.pump.pressure, '-', '-', sep='\t')
        
        # storage to air
        storage_to_air = False
        if self.storage.pressure > p_atm+p_check:
            if self.valve3.orientation == 1 or self.valve3.orientation == 2:
                if self.valve3.state == True:
                    storage_to_air = True
                    if self.valve3.threshold_triger == self.storage or self.valve3.threshold_triger == self.pump:
                        self.storage.Set_pressure(self.valve3.threshold_to_off)
                    else:
                        self.storage.Set_pressure(p_atm + p_check)
        
        self.valve1.Update()
        self.valve2.Update()
        self.valve3.Update()
        
class Cycle:
    envs = []
    
    def __init__(self, t1, t2, t3, wetness, windspeed):
        envs = []
        env1 = Environment(t1, wetness, windspeed)
        env2 = Environment(t2, wetness, windspeed)
        env3 = Environment(t3, wetness, windspeed)
        
        envs.append(env1)
        envs.append(env2)
        envs.append(env3)
        
        self.envs = envs
    
    def __getitem__(self, i):
        return self.envs[i]

class CycleRun:
    cycle_frame_count = 20 # frame count in simulation of every cycle
    current_cycle_index = 0
    current_cycle_frame_index = 0
    
    cycle_list = []
    cycle_count = 0
    
    circuit = ''
    env = ''
    pumping_time = 0
    max_pumping_time = 50
    
    # cycle_index, temperature, wetness, wind_speed, pumping_pressure, pump_pressure, pump_pumping_volume, storage_pressure, storage_vin_p0, v1, v2, v3, pumping_time 
    simulation_result = []
    v1_t = False
    v1_is_change = False
    v2_t = False
    v2_is_change = False
    v3_t = False
    v3_is_change = False

    last_storage_pressure = 0
    last_storage_volume_in_p0 = 0
    
    def __init__(self, cycle_list, circuit, env):
        self.cycle_list = cycle_list
        self.cycle_count = len(self.cycle_list)
        self.circuit = circuit
        self.env = env
        
        # self.env.temperature = 23
        # self.env.wetness = 0
        # self.env.windspeed = 0
        self.SimulatePressureList([p_atm, p_atm, p_atm, p_atm, p_atm])
        #print(1, '%.2f'%self.env.temperature, '%.2f'%self.env.wetness, '%.2f'%self.env.windspeed, '%.2f'%(self.env.pumping_pressure - p_atm), '%.2f'%(self.circuit.pump.pressure-p_atm), '%.2f'%self.circuit.pump.pumping_volume, '%.2f'%(self.circuit.storage.pressure-p_atm), '%.2f'%self.circuit.storage.volume_in_p0, \
                #self.circuit.valve1.state, self.circuit.valve2.state, self.circuit.valve3.state, self.pumping_time, sep='\t')       

        self.last_storage_pressure = self.circuit.storage.pressure
        self.last_storage_volume_in_p0 = self.circuit.storage.volume_in_p0

    # 读取当前的环境和电路状态,
    # 计算下一时刻的环境和电路状态
        
    def to_Pressure(self, new_temperature, new_wetness, new_windspeed):
        type = self.circuit.pump.type
        simulate_pressure_list = []
        if type == 1:
            if new_temperature != self.env.temperature:
                new_pressure = Novec_pressure(new_temperature)
                if new_pressure < p_atm - p_check:
                    new_pressure = p_atm - p_check - 0.2
                simulate_pressure_list = [new_pressure]
        elif type == 2:
            new_pressure = Wet_pressure(new_wetness)
            if new_wetness != self.env.wetness:
                if new_pressure == p_atm:
                    new_pressure = p_atm - p_check - 0.2
                old_pressure = self.env.pumping_pressure
                simulate_pressure_list = linlist(old_pressure, new_pressure, 0.2)
            else:
                simulate_pressure_list = [new_pressure]
        elif type == 3:
            new_pressure = Wind_pressure(new_windspeed)
            if new_windspeed != self.env.windspeed:
                if new_pressure == p_atm:
                    new_pressure = p_atm - p_check - 0.2
                old_pressure = self.env.pumping_pressure
                simulate_pressure_list = linlist(old_pressure, p_atm - p_check - 0.1, 0.5) + linlist(p_atm - p_check - 0.1, new_pressure, 0.2)
            else:
                simulate_pressure_list = [new_pressure]
        return simulate_pressure_list
    
    def Run(self): # 执行一帧
        running = True # 是否结束
        current_cycle = self.cycle_list[self.current_cycle_index]
        
        self.v1_t = self.circuit.valve1.state
        self.v1_is_change = False
        self.v2_t = self.circuit.valve2.state
        self.v2_is_change = False
        self.v3_t = self.circuit.valve3.state
        self.v3_is_change = False

        new_temperature = 0
        new_wetness = 0
        new_windspeed = 0
        
        if self.current_cycle_frame_index < self.cycle_frame_count/2:
            new_temperature = current_cycle[0].temperature + (current_cycle[1].temperature - current_cycle[0].temperature) * \
                ((self.current_cycle_frame_index)/self.cycle_frame_count*2) 
        else:
            new_temperature = current_cycle[1].temperature - (current_cycle[1].temperature - current_cycle[2].temperature) * \
                ((self.current_cycle_frame_index - self.cycle_frame_count/2)/self.cycle_frame_count*2)
        
        new_wetness = current_cycle[0].wetness
        new_windspeed = current_cycle[0].windspeed
        
        # calculate new environment parameter
        simulate_pressure_list = self.to_Pressure(new_temperature, new_wetness, new_windspeed)
        self.env.temperature = new_temperature
        self.env.wetness = new_wetness
        self.env.windspeed = new_windspeed

        # simulate
        self.SimulatePressureList(simulate_pressure_list)
        #print(self.v3_t)
        
        if self.circuit.pump.type == 3 and len(simulate_pressure_list) > 1:
            new_pressure = simulate_pressure_list[-1]
            cycle_pressure_list = linlist(new_pressure, p_atm - p_check - 0.1, 0.5) + linlist(p_atm - p_check - 0.1, new_pressure, 0.5)
            
            last_storage_pressure = 0
            last_storage_volume_in_p0 = 0
            wind_cycle_running = True
            while wind_cycle_running:    
                last_storage_pressure = self.circuit.storage.pressure
                last_storage_volume_in_p0 = self.circuit.storage.volume_in_p0
                self.SimulatePressureList(cycle_pressure_list)
                self.pumping_time += 1
                if self.circuit.storage.type != 3:
                    if abs(last_storage_volume_in_p0 - self.circuit.storage.volume_in_p0) < 0.01 and \
                        abs(last_storage_pressure - self.circuit.storage.pressure) < 0.01:
                        wind_cycle_running = False
                else:
                    if new_pressure < self.circuit.storage.p_elastic + p_atm:
                        wind_cycle_running = False
                    elif abs(self.circuit.storage.volume_in_p0 - self.circuit.storage.max_volume) < 0.1 or self.pumping_time > self.max_pumping_time:
                        wind_cycle_running = False
        
        #周期结束
        self.current_cycle_frame_index += 1
        if self.current_cycle_frame_index == self.cycle_frame_count:
            if self.circuit.pump.type == 1 or (self.circuit.pump.type == 2):
                if  abs(self.last_storage_volume_in_p0 - self.circuit.storage.volume_in_p0) > 0.01 or abs(self.last_storage_pressure - self.circuit.storage.pressure) > 0.01:
                    self.pumping_time += 1
                    self.last_storage_pressure = self.circuit.storage.pressure
                    self.last_storage_volume_in_p0 = self.circuit.storage.volume_in_p0

            self.current_cycle_frame_index = 0
            self.current_cycle_index += 1
            if self.current_cycle_index == self.cycle_count:
                self.current_cycle_index = 0
                running = False
                
        result = []
        result.append(self.current_cycle_frame_index/self.cycle_frame_count + self.current_cycle_index + 1)
        result.append(self.env.temperature)
        result.append(self.env.wetness)
        result.append(self.env.windspeed)
        result.append(self.env.pumping_pressure - p_atm)
        result.append(self.circuit.pump.pressure-p_atm)
        result.append(self.circuit.pump.pumping_volume)
        result.append(self.circuit.storage.pressure-p_atm)
        result.append(self.circuit.storage.volume_in_p0)
        result.append(self.v1_t)
        result.append(self.v2_t)
        result.append(self.v3_t)
        result.append(self.pumping_time)
        self.simulation_result.append(result)
        
        return running
    
    def SimulatePressureList(self, p_list):
        for i in range(len(p_list)):
            p = p_list[i]
            self.env.pumping_pressure = p
            p1, p2, p3, p4 = 0,0,0,0
            running = True
            running_time = 0
            while running:
                p1 = self.circuit.pump.pressure
                p2 = self.circuit.pump.pumping_volume
                p3 = self.circuit.storage.pressure
                p4 = self.circuit.storage.volume_in_p0
                self.circuit.Pump_air()
                if self.circuit.valve1.state != self.v1_t and self.v1_is_change == False:
                    self.v1_t = self.circuit.valve1.state
                    self.v1_is_change = True
                if self.circuit.valve2.state != self.v2_t and self.v2_is_change == False:
                    self.v2_t = self.circuit.valve2.state
                    self.v2_is_change = True
                if self.circuit.valve3.state != self.v3_t and self.v3_is_change == False:
                    self.v3_t = self.circuit.valve3.state
                    self.v3_is_change = True
                running_time += 1
                if abs(p1 - self.circuit.pump.pressure) < 0.01 and \
                    abs(p2 - self.circuit.pump.pumping_volume)<0.01 and \
                    abs(p3 - self.circuit.storage.pressure)<0.01 and \
                    abs(p4 - self.circuit.storage.volume_in_p0)<0.01:
                    running = False
            #print(' ', 'running:',running_time, '%.2f'%(p-p_atm), '%.2f'%(self.circuit.pump.pressure-p_atm), '%.2f'%self.circuit.pump.pumping_volume, '%.2f'%(self.circuit.storage.pressure-p_atm), '%.2f'%self.circuit.storage.volume_in_p0, self.pumping_time,sep='\t')
                 #self.circuit.valve1.state, self.circuit.valve2.state, self.circuit.valve3.state, self.pumping_time, sep='\t')    


if not update:
    results = x
    manuals = manual_list[0]
else:
    env = Environment(23, 0, 0)
    circuit1 = Circuit(env)
    
    circuit1.pump = Pump(int(pump_input), 50)
    circuit1.storage = Storage(int(storage_input[0]), float(storage_input[1]), float(storage_input[2]))
    
    i = 0
    if valve_input[i][5] == 'pump':
        circuit1.valve1 = Valve(int(valve_input[i][0]), bool(int(valve_input[i][1])), int(valve_input[i][2]), float(valve_input[i][3]), float(valve_input[i][4]), circuit1.pump)
    elif valve_input[i][5] == 'storage':
        circuit1.valve1 = Valve(int(valve_input[i][0]), bool(int(valve_input[i][1])), int(valve_input[i][2]), float(valve_input[i][3]), float(valve_input[i][4]), circuit1.storage)
    else:
        circuit1.valve1 = Valve(int(valve_input[i][0]), bool(int(valve_input[i][1])), int(valve_input[i][2]), float(valve_input[i][3]), float(valve_input[i][4]), env)
    i = 1
    if valve_input[i][5] == 'pump':
        circuit1.valve2 = Valve(int(valve_input[i][0]), bool(int(valve_input[i][1])), int(valve_input[i][2]), float(valve_input[i][3]), float(valve_input[i][4]), circuit1.pump)
    elif valve_input[i][5] == 'storage':
        circuit1.valve2 = Valve(int(valve_input[i][0]), bool(int(valve_input[i][1])), int(valve_input[i][2]), float(valve_input[i][3]), float(valve_input[i][4]), circuit1.storage)
    else:
        circuit1.valve2 = Valve(int(valve_input[i][0]), bool(int(valve_input[i][1])), int(valve_input[i][2]), float(valve_input[i][3]), float(valve_input[i][4]), env)
    i = 2
    if valve_input[i][5] == 'pump':
        circuit1.valve3 = Valve(int(valve_input[i][0]), bool(int(valve_input[i][1])), int(valve_input[i][2]), float(valve_input[i][3]), float(valve_input[i][4]), circuit1.pump)
    elif valve_input[i][5] == 'storage':
        circuit1.valve3 = Valve(int(valve_input[i][0]), bool(int(valve_input[i][1])), int(valve_input[i][2]), float(valve_input[i][3]), float(valve_input[i][4]), circuit1.storage)
    else:
        circuit1.valve3 = Valve(int(valve_input[i][0]), bool(int(valve_input[i][1])), int(valve_input[i][2]), float(valve_input[i][3]), float(valve_input[i][4]), env)
    
    cycle_list_input = []
    cycle_count = cycle_input[0]
    for i in range(cycle_count):
        new_cycle = Cycle(cycle_input[i+1][0],cycle_input[i+1][1],cycle_input[i+1][2],cycle_input[i+1][3],cycle_input[i+1][4])
        cycle_list_input.append(new_cycle)

    cycleRun = CycleRun(cycle_list_input, circuit1, env)
    
    running = True
    while running: 
        running = cycleRun.Run()
    x = cycleRun.simulation_result
    
    manual_list = ['']
    if circuit1.pump.type == 1:
        manual_list[0] += 'Thermal Pump Material List and Assembly Instruction .pdf\n'
    elif circuit1.pump.type == 2:
        manual_list[0] += 'Moisture Pump Material List and Assembly Instruction .pdf\n'
    elif circuit1.pump.type == 3:
        manual_list[0] += 'Kinetic Pump Material List and Assembly Instruction .pdf\n'
    
    if circuit1.valve2.type == 1:
        if circuit1.valve2.state_normal == True:
            manual_list[0] += 'NO Thermal Valve Material List and Assembly Instruction .pdf\n'
        elif circuit1.valve2.state_normal == False:
            manual_list[0] += 'NC Thermal Valve Material List and Assembly Instruction .pdf\n'
    elif circuit1.valve2.type == 2:
        manual_list[0] += 'Moisture Valve Material List and Assembly Instruction .pdf\n'
    elif circuit1.valve2.type == 3:
        manual_list[0] += 'Bursting Valve Material List and Assembly Instruction .pdf\n'
    
    if circuit1.valve3.type == 1:
        if circuit1.valve3.state_normal == True:
            manual_list[0] += 'NO Thermal Valve Material List and Assembly Instruction .pdf\n'
        elif circuit1.valve3.state_normal == False:
            manual_list[0] += 'NC Thermal Valve Material List and Assembly Instruction .pdf\n'
    elif circuit1.valve3.type == 2:
        manual_list[0] += 'Moisture Valve Material List and Assembly Instruction .pdf\n'
    elif circuit1.valve3.type == 3:
        manual_list[0] += 'Bursting Valve Material List and Assembly Instruction .pdf\n'
    
    manuals = manual_list[0]
# ---------- end python_42 ----------
panel_29 = Panel(python_42.out)
panel_30 = Panel(python_42.manuals)
values_34 = ValueListener(Elements=slider, SomeProperty=True)  # -> Values, Indices
separator_6 = CreateSeparator(Thickness=0.5, Horizontal=True, Color=swatch_2)
multiplication = Multiplication(A=number_slider_6, B=Slider(2.3, range=0..10))
pt = ConstructPoint(XCoordinate=0, YCoordinate=0, ZCoordinate=expr("-x", Slider(7, range=0..100)))
addition = Addition(A=Slider(27, range=0..100), B=number_slider_6)
pt_2 = ConstructPoint(XCoordinate=0, YCoordinate=0, ZCoordinate=Slider(15.5, range=0..100))
subtraction = Subtraction(A=number_slider_7, B=Slider(5, range=0..10))
xy = XYPlane(Origin=pt_2)
number_slider_8 = Slider(0.9, range=0..1)
xy_2 = XYPlane(Origin=pt)
python_43 = GhPythonScript(x=values_33.Values)  # -> a
# ---------- python_43: Python ----------
__author__ = "busin"
__version__ = "2023.03.30"

import rhinoscriptsyntax as rs
if x:
    a = 0
# ---------- end python_43 ----------
pt_3 = ConstructPoint(XCoordinate=expr("-x", addition), YCoordinate=0, ZCoordinate=0)
pt_4 = ConstructPoint(XCoordinate=expr("-x", number_slider_5), YCoordinate=0, ZCoordinate=0)
pt_5 = ConstructPoint(XCoordinate=expr("-x", number_slider_7), YCoordinate=0, ZCoordinate=0)
pt_6 = ConstructPoint(XCoordinate=subtraction, YCoordinate=0, ZCoordinate=0)
pt_7 = ConstructPoint(XCoordinate=number_slider_5, YCoordinate=0, ZCoordinate=0)
python_44 = GhPythonScript(x=values_21.Values, z=values_34.Values, y=Slider(20, range=0..100))  # -> out, a
# ---------- python_44: Python ----------
__author__ = "busin"
__version__ = "2023.03.30"

import rhinoscriptsyntax as rs
a = z*y
max= x*y
if a > max - 1:
    a = max - 1
# ---------- end python_44 ----------
python_45 = GhPythonScript(results=python_42.results, frame=python_44.a)  # -> out, temperature, wetness, windspeed, pumping_pressure, pump_pressure, pump_pumping_volume, storage_pressure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; inputs results: list, frame: Int32
# ---------- python_45: Python ----------
__author__ = "yutianyu"

import rhinoscriptsyntax as rs

r = results[frame]
print(r)
temperature = r[1]
wetness = r[2]
windspeed = r[3]
pumping_pressure = r[4]
pump_pressure = r[5]
pump_pumping_volume = r[6]
storage_pressure = r[7]
storage_volume = r[8]
valve1 = r[9]
valve2 = r[10]
valve3 = r[11]
pumping_time = r[12]
# ---------- end python_45 ----------
panel_31 = Panel(python_45.storage_pressure)
panel_32 = Panel(python_45.valve2)
panel_33 = Panel(python_45.valve3)
panel_34 = Panel(python_45.pump_pressure)
panel_35 = Panel(python_45.storage_volume)
panel_36 = Panel(python_45.pumping_pressure)
panel_37 = Panel(python_45.pump_pumping_volume)
python_46 = GhPythonScript(x=panel_35, reset=bool, on=toggle)  # -> out, a
# ---------- python_46: Python ----------
__author__ = "yutianyu"

import rhinoscriptsyntax as rs

tau = 2
if reset:
    r = 0
else:
    if on:
        delta = (x-r)/tau
        if abs(delta) < 0.01:
            delta = 0
        r += delta
    else:
        r = x

a = r
# ---------- end python_46 ----------
python_47 = GhPythonScript(x=panel_31, reset=bool, on=toggle)  # -> out, a; same code as python_46
python_48 = GhPythonScript(x=panel_37, reset=bool, on=toggle)  # -> out, a; same code as python_46
python_49 = GhPythonScript(x=panel_34, reset=bool, on=toggle)  # -> out, a; same code as python_46
merge_15 = Merge(Data1=panel_32, Data2=panel_33)
gradient = Gradient(
    LowerLimit=number_slider_2,
    UpperLimit=number_slider,
    Parameter=python_47.a,
    stops=[0: RGBA(168, 168, 168, 35), 1: RGBA(255, 0, 0, 61)])
cluster_12 = Cluster_3(L=python_16.storage, relay=python_46.a)  # -> i, a_2, a
python_50 = GhPythonScript(
    valve1=python_17.valve_display,
    valve2=python_18.valve_display,
    pump_diameter=Slider(35, range=0..100),
    valve_diameter=Slider(13, range=0..100),
    storage_diameter=cluster_12.a_2,
    margin=number_slider_3)  # -> out, valve_orientation, valve_type, valve1_x, storage_x, valve2_x; inputs valve1: list, valve2: list
# ---------- python_50: Python ----------
__author__ = "busin"
__version__ = "2023.04.01"

import rhinoscriptsyntax as rs
valve1_x = 0
storage_x = 0
valve2_x = 0
valve_orientation = [0, 0]
valve_type = [0, 0]

if int(valve1[1]) > 0:
    valve1_x = pump_diameter + margin + valve_diameter
    valve_orientation[0] = valve1[1]
    valve_type[0] = valve1[0]
else:
    valve1_x = pump_diameter - valve_diameter

storage_x = valve1_x + valve_diameter + margin + storage_diameter

if int(valve2[1]) > 0:
    valve2_x = storage_x + storage_diameter + margin + valve_diameter
    valve_orientation[1] = valve2[1]
    valve_type[1] = valve2[0]
# ---------- end python_50 ----------
addition_2 = Addition(A=python_50.storage_x, B=cluster_12.a)
subtraction_2 = Subtraction(A=python_50.storage_x, B=cluster_12.a)
addition_3 = Addition(A=python_50.storage_x, B=cluster_12.a_2)
expression = Expression(x=python_48.a, Expression="x/(π*3*3)*10+0.9")
python_51 = GhPythonScript(x="Pressure (kPa): ", y=python_47.a)  # -> out, a
# ---------- python_51: Python ----------
__author__ = "busin"
__version__ = "2023.03.30"

import rhinoscriptsyntax as rs
a = x + str(round(y,1))
# ---------- end python_51 ----------
python_52 = GhPythonScript(x="Air volume (mL@p0): ", y=python_46.a)  # -> out, a
# ---------- python_52: Python ----------
__author__ = "busin"
__version__ = "2023.03.30"

import rhinoscriptsyntax as rs
a = x + str(int(y))
# ---------- end python_52 ----------
python_53 = GhPythonScript(x="Pressure (kPa): ", y=python_49.a)  # -> out, a
# ---------- python_53: Python ----------
__author__ = "busin"
__version__ = "2023.03.30"

import rhinoscriptsyntax as rs
a = x + str(round(y, 1))
# ---------- end python_53 ----------
python_54 = GhPythonScript(x="Pumping counts: ", y=python_45.pumping_time)  # -> out, a
# ---------- python_54: Python ----------
__author__ = "busin"
__version__ = "2023.03.30"

import rhinoscriptsyntax as rs
if y >= 50:
    a = x + "..."
else:
    a = x + "~" + str(int(y))
# ---------- end python_54 ----------
python_55 = GhPythonScript(x="Temperature (℃): ", y=python_45.temperature)  # -> out, a
# ---------- python_55: Python ----------
__author__ = "busin"
__version__ = "2023.03.30"

import rhinoscriptsyntax as rs
a = x + str(round(y,2))
# ---------- end python_55 ----------
python_56 = GhPythonScript(x="Windspeed (m/s): ", y=python_45.windspeed)  # -> out, a
# ---------- python_56: Python ----------
__author__ = "busin"
__version__ = "2023.03.30"

import rhinoscriptsyntax as rs
a = x + str(round(y, 2))
# ---------- end python_56 ----------
python_57 = GhPythonScript(x="Moisture/water bath: ", y=python_45.wetness)  # -> out, a
# ---------- python_57: Python ----------
__author__ = "busin"
__version__ = "2023.03.30"

import rhinoscriptsyntax as rs
if y == 1:
    a = x + 'wet'
else:
    a = x + 'dry'
# ---------- end python_57 ----------
expression_2 = Expression(x=python_48.a, Expression="21-x/(π*3*3)*10+0.5")
addition_4 = Addition(A=subtraction_2, B=number_slider_4)
subtraction_3 = Subtraction(A=addition_2, B=number_slider_4)
merge_16 = Merge(Data1=python_53.a, Data2=python_54.a)
setlabel_14 = SetLabelContents(LabelToModify=label_21, NewLabelContents=python_57.a)
setlabel_15 = SetLabelContents(LabelToModify=label_20, NewLabelContents=python_55.a)
setlabel_16 = SetLabelContents(LabelToModify=label_19, NewLabelContents=python_56.a)
addition_5 = Addition(A=addition_3, B=multiplication)
gradient_2 = Gradient(
    LowerLimit=number_slider_2,
    UpperLimit=number_slider,
    Parameter=python_49.a,
    stops=[0: RGBA(255, 219, 166, 34), 1: RGBA(255, 0, 0, 61)])
python_58 = GhPythonScript(
    orientation=python_50.valve_orientation,
    x=merge_15,
    c0=ColourSwatch(SwatchColor=RGB(130, 187, 237)),
    c1=ColourSwatch(SwatchColor=RGBA(130, 187, 237, 100)))  # -> out, a, b; inputs orientation: list of Int32, x: list of Boolean
# ---------- python_58: Python ----------
__author__ = "yutianyu"

import rhinoscriptsyntax as rs

a = []
b=[' ', ' ']
for j in x:
    if j:
        a.append(c1)
    else:
        a.append(c0)

for i in range(2):
    if orientation[i]>0:
        if x[i]:
            b[i] = 'Open'
        else:
            b[i] = 'Closed'
# ---------- end python_58 ----------
python_59 = GhPythonScript(x=python_50.valve_orientation, v1=cluster_11.M, v2=cluster_11.M_2)  # -> out, v
# ---------- python_59: Python ----------
__author__ = "yutianyu"

import rhinoscriptsyntax as rs
if x == 1:
    v = v1
elif x == 2:
    v = v2
elif x == 3:
    v = v2
# ---------- end python_59 ----------
merge_17 = Merge(Data1=python_50.valve1_x, Data2=python_50.valve2_x)
pt_8 = ConstructPoint(XCoordinate=subtraction_3, YCoordinate=0, ZCoordinate=0)
pt_9 = ConstructPoint(XCoordinate=addition_5, YCoordinate=0, ZCoordinate=0)
pt_10 = ConstructPoint(XCoordinate=addition_4, YCoordinate=0, ZCoordinate=0)
pflip = FlipPlane(Plane=xy, ReverseX=False, ReverseY=False, SwapAxes=True)
merge_18 = Merge(
    Data1=separator_5,
    Data2=label_22,
    Data3=button_2,
    Data4=slider,
    Data5=label_20,
    Data6=label_21,
    Data7=label_19,
    Data8=separator_6,
    Data9=label_18,
    Data10=button)
merge_19 = Merge(Data1=label_17, Data2=textbox_10, Data3=scrollviewer, Data4=merge_18)
stack_2 = CreateStack(UIElements=merge_19, Horizontal=False)
entwine_2 = Entwine(Branch00=stack, Branch02=stack_2, FlattenInputs=True)
simplegrid_10 = CreateSimpleGrid(UIElements=entwine_2, Width=Slider(904, range=0..1000), RowDefinitions="Auto", ColumnDefinitions=panel_28)  # -> flatten(SimpleGrid)
addelems = AddElements(Window=launchwin, Elements=flatten(simplegrid_10), DoVLChecking=True)  # -> AddedElements, ElementNames
data_11 = Data(python_59.v)
ln = Line(StartPoint=pt_3, EndPoint=pt_4)
X = UnitX(Factor=merge_17)
ln_2 = Line(StartPoint=pt_7, EndPoint=pt_10)
dom = ConstructDomain(DomainStart=0, DomainEnd=values_21.Values)

cluster_13 = Cluster_2(O=pt_5)
cluster_14 = Cluster_2(O=pt_6)

ln_3 = Line(StartPoint=pt_8, EndPoint=pt_9)
cyl = Cylinder(Base=pflip, Radius=Slider(29.5, range=0..100), Length=expression)
cyl_2 = Cylinder(Base=xy_2, Radius=Slider(29.5, range=0..100), Length=expression_2)
X_2 = UnitX(Factor=python_50.storage_x)
move = Move(Geometry=data_11, Motion=X)  # -> Geometry, Transform
number_slider_9 = Slider(15, range=0..100)
number_slider_10 = Slider(2, range=0..10)
cap = CapHoles(Brep=cyl)
cap_2 = CapHoles(Brep=cyl_2)
setslider = SetSlider(UISlider=slider, Value=python_43, Range=dom)
move_2 = Move(Geometry=cluster_12.i, Motion=X_2)  # -> Geometry, Transform
merge_20 = Merge(Data1=ln, Data2=ln_2)  # -> flatten(Result)
preview = CustomPreview(Geometry=move.Geometry, Material=python_58.a)
mesh = MeshBrep(
    Brep=cap,
    Settings={GridMaxCount=0, GridMinCount=16, JaggedSeams=False, MaxEdgeLength=0, MinEdgeLength=0.0001, MinTolerance=0, Refine=True, RefineAngle=0, RelativeTolerance=0.65, SimplePlanes=True, Tolerance=0})
mesh_2 = MeshBrep(
    Brep=cap_2,
    Settings={GridMaxCount=0, GridMinCount=16, JaggedSeams=False, MaxEdgeLength=0, MinEdgeLength=0.0001, MinTolerance=0, Refine=True, RefineAngle=0, RelativeTolerance=0.65, SimplePlanes=True, Tolerance=0})
preview_2 = CustomPreview(Geometry=[cluster_13, cluster_14], Material=ColourSwatch(SwatchColor=RGB(227, 227, 227)))
volume = Volume(Geometry=move.Geometry)  # -> Volume, Centroid
preview_3 = CustomPreview(Geometry=move_2.Geometry, Material=gradient)
preview_4 = CustomPreview(Geometry=mesh_2, Material=gradient_2)
preview_5 = CustomPreview(Geometry=mesh, Material=ColourSwatch(SwatchColor=RGBA(255, 204, 133, 92)))
mpipe = MeshPipe(Curve=ln_3, Radius=number_slider_10, Accuracy=0.2, Rotation=0, Segments=number_slider_9, Caps=0)
mpipe_2 = MeshPipe(Curve=merge_20, Radius=number_slider_10, Accuracy=0.2, Rotation=0, Segments=number_slider_9, Caps=0)
item_6 = ListItem(List=volume.Centroid, Index=0, Wrap=True)  # -> Item, Item1
item_7 = ListItem(List=python_50.valve_orientation, Index=0, Wrap=True)  # -> Item, Item1
item_8 = ListItem(List=python_50.valve_type, Index=0, Wrap=True)  # -> Item, Item1
number_slider_11 = Slider(6.5, range=0..10)
number_slider_12 = Slider(65, range=0..100)
or_4 = GateOr(A=values_32.Values, B=False)
pt_11 = ConstructPoint(XCoordinate=0, YCoordinate=0, ZCoordinate=Slider(35, range=0..100))
label_23 = CreateLabel(LabelText=" ", LabelSize=12, Justification=0)
python_60 = GhPythonScript(x=item_7.Item1, y=mpipe)  # -> out, a; inputs x: Int32
# ---------- python_60: Python ----------
__author__ = "busin"
__version__ = "2023.03.31"

import rhinoscriptsyntax as rs
if x == 1:
    a = y
# ---------- end python_60 ----------
crv = Curve(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)
crv_2 = Curve([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])
number_slider_13 = Slider(65, range=0..100)
number_slider_14 = Slider(6.5, range=0..10)
not_6 = GateNot(A=or_4)
srf = Surface(crv)
crv_3 = Curve(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)
crv_4 = Curve([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])
crv_5 = Curve(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)
crv_6 = Curve([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])
merge_21 = Merge(Data1=crv_2, Data2=srf)
setlabel_17 = SetLabelContents(LabelToModify=label_23, NewLabelContents=python_42.manuals)
addition_6 = Addition(A=pt_11, B=volume.Centroid)
crv_7 = Curve([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])
crv_8 = Curve([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])
preview_6 = CustomPreview(Geometry=[mpipe_2, python_60.a], Material=ColourSwatch(SwatchColor=RGBA(209, 209, 209, 51)))
srf_2 = Surface(crv_3)
pt_12 = ConstructPoint(XCoordinate=0, YCoordinate=0, ZCoordinate=Slider(11, range=0..100))
launchwin_2 = LaunchWindow(Show=not_6, Name="Manual Lists", Width=370, Height=Slider(200, range=0..1000), ChildStatus=2, EnableHorizScroll=False)
srf_3 = Surface(crv_5)
multiplication_2 = Multiplication(A=number_slider_11, B=2)
python_61 = GhPythonScript(
    orientation=python_50.valve_orientation,
    type=python_50.valve_type,
    valve_input=python_19.valves,
    center=volume.Centroid,
    storage_x=python_50.storage_x,
    color_pump=gradient_2,
    color_storage=gradient)  # -> out, a, b, c; inputs orientation: list, type: list, valve_input: list, center: list
# ---------- python_61: Python ----------
__author__ = "busin"
__version__ = "2023.04.01"

import rhinoscriptsyntax as rs
a = []
b = []
c = []
for i in range(2):
    if type[i] == 3 and valve_input[i+1][5]!='env':
        a.append(center[i])
        if valve_input[i+1][5] == 'pump':
            b.append(0)
            c.append(color_pump)
        elif valve_input[i+1][5] == 'storage':
            b.append(storage_x)
            c.append(color_storage)
# ---------- end python_61 ----------
larger = LargerThan(FirstNumber=cluster_12.a_2, SecondNumber=0)  # -> LargerThan, OrEqualTo
merge_22 = Merge(Data1=python_52.a, Data2=python_51.a)
Z = UnitZ(Factor=Slider(16.5, range=0..100))
addition_7 = Addition(A=cluster_12.a_2, B=Slider(40, range=0..100))
merge_23 = Merge(Data1=crv_4, Data2=srf_2)
xz = XZPlane(Origin=addition_6)
crv_9 = Curve([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])
crv_10 = Curve([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])
merge_24 = Merge(Data1=crv_6, Data2=srf_3)
python_62 = GhPythonScript(x=python_2.index, y=merge_21, z=crv_8, u=crv_7)  # -> out, a; inputs y: list, z: list, u: list
# ---------- python_62: Python ----------
__author__ = "busin"
__version__ = "2023.04.01"

import rhinoscriptsyntax as rs
if x == 1:
    a = y
elif x == 2:
    a = z
elif x == 3:
    a = u
# ---------- end python_62 ----------
crv_11 = Curve([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])
crv_12 = Curve([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])
subtraction_4 = Subtraction(A=number_slider_12, B=multiplication_2)
multiplication_3 = Multiplication(A=number_slider_14, B=2)
subtraction_5 = Subtraction(A=number_slider_13, B=multiplication_3)
addelems_2 = AddElements(Window=launchwin_2, Elements=flatten(label_23), DoVLChecking=True)  # -> AddedElements, ElementNames
gate = StreamGate(Stream=merge_22, Gate=larger.LargerThan)  # -> Target0, Target1
addition_8 = Addition(A=pt_12, B=item_6.Item1)
neg = Negative(Value=addition_7)
python_63 = GhPythonScript(orientation=item_7.Item, type=item_8.Item, y=merge_23, z=crv_10, u=crv_9)  # -> out, a; inputs y: list, z: list, u: list
# ---------- python_63: Python ----------
__author__ = "busin"
__version__ = "2023.04.01"

import rhinoscriptsyntax as rs
if orientation:
    if type == 1:
        a = y
    elif type == 2:
        a = z
    elif type == 3:
        a = u
# ---------- end python_63 ----------
tag = TextTag3D(
    Location=xz,
    Text=python_58.b,
    Size=Slider(6.5, range=0..10),
    Colour=ColourSwatch(SwatchColor=RGB(64, 64, 64)),
    Justification=2)
python_64 = GhPythonScript(orientation=item_7.Item1, type=item_8.Item1, y=merge_24, z=crv_12, u=crv_11)  # -> out, a; inputs y: list, z: list, u: list; same code as python_63
move_3 = Move(Geometry=python_62.a, Motion=Z)  # -> Geometry, Transform
addition_9 = Addition(A=pt_12, B=item_6.Item)
pt_13 = ConstructPoint(XCoordinate=0, YCoordinate=0, ZCoordinate=[number_slider_12, subtraction_4])
pt_14 = Point(python_61.a)
pt_15 = ConstructPoint(XCoordinate=python_50.storage_x, YCoordinate=0, ZCoordinate=[number_slider_13, subtraction_5])
pdecon = Deconstruct(Point=pt_14)  # -> XComponent, YComponent, ZComponent
move_4 = Move(Geometry=python_63.a, Motion=addition_9)  # -> Geometry, Transform
move_5 = Move(Geometry=python_64.a, Motion=addition_8)  # -> Geometry, Transform
xz_2 = XZPlane(Origin=pt_13)
xz_3 = XZPlane(Origin=pt_15)
previewlw = CustomPreviewLineweights(
    Geometry=move_3.Geometry,
    Shader=ColourSwatch(SwatchColor=RGB(242, 146, 12)),
    Thickness=Slider(1.1, range=0..3),
    Absolute=True)
pt_16 = ConstructPoint(XCoordinate=pdecon.XComponent, YCoordinate=neg, ZCoordinate=0)
pt_17 = ConstructPoint(XCoordinate=python_61.b, YCoordinate=neg, ZCoordinate=0)
pt_18 = ConstructPoint(XCoordinate=python_61.b, YCoordinate=0, ZCoordinate=0)
tag_2 = TextTag3D(Location=xz_2, Text=merge_16, Size=number_slider_11, Colour=ColourSwatch(SwatchColor=RGB(64, 64, 64)), Justification=2)
tag_3 = TextTag3D(
    Location=xz_3,
    Text=gate.Target1,
    Size=number_slider_14,
    Colour=ColourSwatch(SwatchColor=RGB(64, 64, 64)),
    Justification=2)
previewlw_2 = CustomPreviewLineweights(
    Geometry=move_4.Geometry,
    Shader=ColourSwatch(SwatchColor=RGB(24, 141, 242)),
    Thickness=Slider(1.1, range=0..3),
    Absolute=True)
previewlw_3 = CustomPreviewLineweights(
    Geometry=move_5.Geometry,
    Shader=ColourSwatch(SwatchColor=RGB(24, 141, 242)),
    Thickness=Slider(1.1, range=0..3),
    Absolute=True)
merge_25 = Merge(Data1=graft(pt_14), Data2=graft(pt_16), Data3=graft(pt_17), Data4=graft(pt_18))
pline = PolyLine(Vertices=merge_25, Closed=False)
fillet = Fillet(Curve=pline, Radius=Slider(6, range=0..10))
material = CreateMaterial(
    Diffuse=RGB(255, 105, 180),
    Specular=RGB(255, 255, 255),
    Emission=python_61.c,
    Transparency=Slider(0.8, range=0..1),
    Shine=0)
mpipe_3 = MeshPipe(Curve=fillet, Radius=Slider(1, range=0..1), Accuracy=0.2, Rotation=0, Segments=10, Caps=2)  # -> flatten(Mesh)
preview_7 = CustomPreview(Geometry=mpipe_3, Material=material)

# ==== cluster Cluster
textbox = CreateTextBox(Label="start", DefaultText="20", UpdateButton=False, showLabel=True)
panel = ClusterOutput("end:")
textbox_2 = CreateTextBox(Label="middle", DefaultText="40", UpdateButton=False, showLabel=True)
label = CreateLabel(LabelText="end:", LabelSize=12, Justification=0)
label_2 = CreateLabel(LabelText="Temperature (℃)", LabelSize=12, Justification=0)
label_3 = CreateLabel(LabelText="Moisture/water bath", LabelSize=12, Justification=0)
textbox_3 = CreateTextBox(Label="Windspeed (m/s）", DefaultText="0", UpdateButton=False, showLabel=True)
checkbox = CreateCheckbox(StartingValue=False)
L = ClusterOutput(label)
merge = Merge(Data2=textbox, Data3=textbox_2, Data4=label)
simplegrid = CreateSimpleGrid(UIElements=graft([label_3, checkbox]), RowDefinitions="Auto", ColumnDefinitions="Auto")  # -> flatten(SimpleGrid)
simplegrid_2 = CreateSimpleGrid(UIElements=graft(merge), RowDefinitions="Auto", ColumnDefinitions="1*")  # -> flatten(SimpleGrid)
merge_2 = Merge(Data1=textbox, Data2=textbox_2, Data3=checkbox, Data4=textbox_3)
merge_3 = Merge(Data1=label_2, Data2=simplegrid_2, Data3=simplegrid, Data4=textbox_3)  # -> flatten(Result)
H = ClusterInput()
R = ClusterOutput(merge_2)
expander = CreateExpander(UIElements=merge_3, Header=H, Open=False)
D = ClusterInput()
hideshow = HideShowElement(ElementToHideShow=expander, Show=True, Collapse=True, Disable=D)
E = ClusterOutput(expander)

# ==== cluster Cluster_2
O = ClusterInput()
yz = YZPlane(Origin=O)
cone = Cone(Base=yz, Radius=Slider(6, range=0..10), Length=Slider(9, range=0..10))  # -> Cone, Tip
cap = CapHoles(Brep=cone.Cone)
mesh = MeshBrep(
    Brep=cap,
    Settings={GridMaxCount=0, GridMinCount=16, JaggedSeams=False, MaxEdgeLength=0, MinEdgeLength=0.0001, MinTolerance=0, Refine=True, RefineAngle=0, RelativeTolerance=0.65, SimplePlanes=True, Tolerance=0})
M = ClusterOutput(mesh)

# ==== cluster Cluster_3
L = ClusterInput()
relay = ClusterInput()
item = ListItem(List=L, Index=0, Wrap=True)  # -> Item, Item1, Item2
mesh = Mesh(<mesh referenced from the Rhino model>)

number_slider = Slider(15, range=0..100)

volume = Volume(Geometry=mesh)  # -> Volume, Centroid; disabled
num = Number(19120.44467)
yz = YZPlane(Origin=Point(0, 0, 0))
division = Division(A=num, B=1000)
pflip = FlipPlane(Plane=yz, ReverseX=False, ReverseY=False, SwapAxes=True)
division_2 = Division(A=number_slider, B=2)
division_3 = Division(A=item.Item1, B=division)
cyl = Cylinder(Base=pflip, Radius=Slider(5, range=0..100), Length=number_slider)
X = UnitX(Factor=division_2)
expression = Expression(x=division_3, Expression="x^(1/3)")
cap = CapHoles(Brep=cyl)
move = Move(Geometry=cap, Motion=X)  # -> Geometry, Transform
pt = ConstructPoint(XCoordinate=0, YCoordinate=0, ZCoordinate=0)
volume_2 = Volume(Geometry=move.Geometry)  # -> Volume, Centroid
expression_2 = Expression(x=item.Item1, Expression="(x*1000*3/4/π)^(1/3)")
expression_3 = Expression(x=relay, Expression="(x*1000*3/4/π)^(1/3)+1")
division_4 = Division(A=relay, B=item.Item1)
scale = Scale(Geometry=mesh, Center=pt, Factor=expression)  # -> Geometry, Transform
division_5 = Division(A=volume_2.Volume, B=1000)
addition = Addition(A=division_4, B=0.1)
multiplication = Multiplication(A=expression, B=Slider(20, range=0..100))
division_6 = Division(A=item.Item1, B=division_5)
scale_nu = ScaleNU(Geometry=scale.Geometry, Plane=PlaneXY(0, 0, 0), ScaleX=1, ScaleY=1, ScaleZ=addition)  # -> flatten(Geometry), Transform
expression_4 = Expression(x=division_6, Expression="x^(1/3)")
msphere = MeshSphere(Base=PlaneXY(0, 0, 0), Radius=expression_3, UCount=Slider(50, range=0..100), VCount=Slider(100, range=0..100))  # -> flatten(Mesh)
python = GhPythonScript(z=item.Item, x=multiplication, y=expression_2)  # -> out, a
# ---------- python: Python ----------
__author__ = "busin"
__version__ = "2023.04.01"

import rhinoscriptsyntax as rs
if z == 3:
    a = y
elif z == 1 or z == 2:
    a = x
else:
    a = 0
# ---------- end python ----------
python_2 = GhPythonScript(z=item.Item, x=multiplication, y=expression_3)  # -> out, a; same code as python
scale_2 = Scale(Geometry=move.Geometry, Center=volume_2.Centroid, Factor=expression_4)  # -> Geometry, Transform
mesh_2 = MeshBrep(
    Brep=scale_2.Geometry,
    Settings={GridMaxCount=0, GridMinCount=16, JaggedSeams=False, MaxEdgeLength=0, MinEdgeLength=0.0001, MinTolerance=0, Refine=True, RefineAngle=0, RelativeTolerance=0.65, SimplePlanes=True, Tolerance=0})  # -> flatten(Mesh)
a = ClusterOutput(python_2.a)
a_2 = ClusterOutput(python.a)
merge = Merge(Data1=flatten(scale_nu.Geometry), Data2=flatten(mesh_2), Data3=flatten(msphere))
subtraction = Subtraction(A=item.Item, B=1)
item_2 = ListItem(List=merge, Index=subtraction, Wrap=False)
i = ClusterOutput(item_2)

# ==== cluster Cluster_4

number_slider = Slider(13, range=0..100)
number_slider_2 = Slider(22, range=0..100)

xy = XYPlane(Origin=Point(0, 0, 0))
addition = Addition(A=number_slider, B=Slider(1.5, range=0..10))
multiplication = Multiplication(A=number_slider, B=Slider(3.5, range=0..10))
cir = Circle(Plane=xy, Radius=number_slider)
cir_2 = Circle(Plane=xy, Radius=addition)
srf = Surface(cir)
srf_2 = Surface(cir_2)
Z = UnitZ(Factor=number_slider_2)
Z_2 = UnitZ(Factor=number_slider_2)
move = Move(Geometry=srf_2, Motion=Z)  # -> Geometry, Transform
extr = Extrude(Base=srf, Direction=Z_2)
Z_3 = UnitZ(Factor=expr("-x", Slider(7, range=0..10)))
extr_2 = Extrude(Base=move.Geometry, Direction=Z_3)
merge = Merge(Data1=extr_2, Data2=extr)
sunion = SolidUnion(Breps=merge)
Z_4 = UnitZ(Factor=expr("-x", Slider(8, range=0..10)))
Y = UnitY(Factor=expr("-x", multiplication))
move_2 = Move(Geometry=sunion, Motion=Z_4)  # -> Geometry, Transform
move_3 = Move(Geometry=move_2.Geometry, Motion=Y)  # -> Geometry, Transform
mesh = MeshBrep(
    Brep=move_2.Geometry,
    Settings={GridMaxCount=0, GridMinCount=16, JaggedSeams=False, MaxEdgeLength=0, MinEdgeLength=0.0001, MinTolerance=0, Refine=True, RefineAngle=0, RelativeTolerance=0.65, SimplePlanes=True, Tolerance=0})
mesh_2 = MeshBrep(
    Brep=move_3.Geometry,
    Settings={GridMaxCount=0, GridMinCount=16, JaggedSeams=False, MaxEdgeLength=0, MinEdgeLength=0.0001, MinTolerance=0, Refine=True, RefineAngle=0, RelativeTolerance=0.65, SimplePlanes=True, Tolerance=0})
M = ClusterOutput(mesh)
M_2 = ClusterOutput(mesh_2)
